# Grasshopper definition FlatNozzle_adaptive_rotation.gh (Grasshopper 1.0.7)
# plug-ins: Pufferfish

number_slider = Slider(20, range=0..100)
brep = Brep(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)
crv = Curve(<curve referenced from the Rhino model>)
volume = Volume(Geometry=brep)  # -> Volume, Centroid
mesh = Mesh(brep)
hframes = HorizontalFrames(Curve=crv, Count=number_slider)  # -> Frames, Parameters
rectangle = Rectangle(Plane=hframes.Frames, XSize=Domain(-1, 1), YSize=Domain(-2, 2), Radius=0)  # -> Rectangle, Length

# ---- group: Tan display
divide = DivideCurve(Curve=crv, Count=number_slider, Kinks=False)  # -> Points, Tangents, Parameters
amp = Amplitude(Vector=divide.Tangents, Amplitude=Slider(6, range=0..100))
vdis = VectorDisplay(Anchor=divide.Points, Vector=amp)

# ----
boundary = BoundarySurfaces(Edges=rectangle.Rectangle)

deplane = DeconstructPlane(Plane=hframes.Frames)  # -> Origin, XAxis, YAxis, ZAxis
vec = VectorXYZ(XComponent=deplane.XAxis, YComponent=0, ZComponent=0)  # -> Vector, Length
amp_2 = Amplitude(Vector=vec.Vector, Amplitude=Slider(5, range=0..100))
vdis_2 = VectorDisplay(Anchor=deplane.Origin, Vector=amp_2)

number_slider_2 = Slider(18, range=0..100)
item = ListItem(List=rectangle.Rectangle, Index=number_slider_2, Wrap=True)
area = Area(Geometry=item)  # -> Area, Centroid
move2pt = MoveToPoint(Geometry=mesh, PointA=volume.Centroid, PointB=area.Centroid)  # -> Moved, Vector, Transform
angle = Angle(VectorA=amp, VectorB=amp_2)  # -> Angle, Reflex
deg = Degrees(Radians=angle.Angle)
tag = TextTag3D(Location=hframes.Frames, Text=deg, Size=1, Colour=ColourSwatch(SwatchColor=RGB(255, 255, 255)), Justification=7)
deg_2 = Degrees(Radians=angle.Angle)
python = GhPythonScript(a=deg_2)  # -> out, angles; inputs a: list
# ---------- python: Python ----------
angles = []

first = True

alpha_p = 0
for idx, val in enumerate(a):
    if first:
        first = False
    else:
        if val > val_p:
            a[idx] = -val
    angles.append(a[idx])
    val_p = a[idx]
# ---------- end python ----------

# ---- group: Ideal Angle
rad = Radians(Degrees=Slider(-15, range=-180..180))
Z = UnitZ(Factor=Slider(12, range=0..100))
move = Move(Geometry=move2pt.Moved, Motion=Z)  # -> Geometry, Transform
item_2 = ListItem(List=rad, Index=number_slider_2, Wrap=True)
rotate = Rotate(Geometry=move.Geometry, Angle=item_2, Plane=area.Centroid)  # -> Geometry, Transform
preview = CustomPreview(
    Geometry=rotate.Geometry,
    Material={diffuse=RGB(221, 160, 221), emission=RGB(66, 48, 66), shine=0.5, specular=RGB(255, 255, 255), transparency=0})

# ----
rad_2 = Radians(Degrees=python.angles)
item_3 = ListItem(List=rad_2, Index=number_slider_2, Wrap=True)

Z_2 = UnitZ(Factor=Slider(12, range=0..100))
move_2 = Move(Geometry=move2pt.Moved, Motion=Z_2)  # -> Geometry, Transform
rotate_2 = Rotate(Geometry=move_2.Geometry, Angle=item_3, Plane=area.Centroid)  # -> Geometry, Transform
preview_2 = CustomPreview(Geometry=rotate_2.Geometry, Material=ColourSwatch(SwatchColor=RGB(157, 26, 186)))

deg_3 = Degrees(Radians=angle.Angle)
panel = Panel(deg_3)
interp = InterpolateData(Data=deg_3, Parameter=1, Interpolation=2)
panel_2 = Panel("""134.137024
122.036996
82.414635
68.313287
43.832063
34.241507
25.500889
7.136757
-15.058972
-29.220982
-69.055909
-103.255815
-78.458628
-125.655165
-171.188217
-102.072484
-99.79806
-176.879834
-165.228914
-137.924681""")
num = Number(panel_2)
panel_3 = Panel(python.angles)
panel_4 = Panel(interp)
